vi "802.11 Host.gvi"   [LabVIEW Communications System Design Suite 2.0.1]
panel controls:
  "Trigger TX": bool
  "Clear events": bool
  "Operation Mode": T2 = "RF Loopback"
  "Primary Subband": UFXP(2.0) = 1
  "Transmit IP Address": string = "127.0.0.1"
  "Transmit Port": u16 = 12346
  "Receive Port": u16 = 12345
  "Tab": i32
  "Power Level [dBm]": f64
  "TX Frequency [Hz]": f64 = 2437000000
  "Destination MAC Address": u8[6] = [71, 111, 75, 117, 109, 98]
  "Device MAC Address": u8[6] = [71, 111, 75, 117, 109, 97]
  "TX Port (USRP only)": enum{"TX1/RF 0", "TX1/RF 1"} = "TX1/RF 0"
  "RX Port (USRP only)": T3 = "RX2/RF 1"
  "AGC": bool = TRUE
  "Manual RX gain [dB]": f64 = 37.5
  "PN Data Packet Size": i32 = 1024
  "Subcarrier Format": i32 = "20 MHz (IEEE 802.11 a)"(0)
  "Stop": bool
  "RIO Device": string = "RIO0"
  "Station": bool
  "reset TX staistics": bool
  "reset RX staistics": bool
  "PN Packets per Second": u32 = 1000
  "Transmit ACK": bool = TRUE
  "Backoff": u16 = 4
  "All": bool
  "None": bool
  "Events to Track": T5
  "CCA Energy Detection Threshold [dBm]": FXP(10.3) = -72
  "MCS": UFXP(4.0) = 4
  "session": "802.11 Host Session.gtype"
  "Data Source Option": i32 = 1
  "Data Sink Options": i32
  "Data Source": T11 = "PN Data"
  "Data Sink": enum{"Off", "UDP"} = "Off"
  "Reference Clock": string = "Internal"
  "USRP bandwidth": "USRP bandwidth.gtype" = "40 MHz"
  "UDP A Port": u16
  "UDP B Port": u16
  "UDP C Port": u16
  "UDP D Port": u16
  "UDP E Port": u16
  "UDP Port Selection (Choose 0 for all other Data Source Options)": u8
  "session_2": "802.11 Host Session.gtype"
panel indicators:
  "Events": string
  "MAC TX Statistic": T1
  "Baseband Power": f64
  "Coerced LO frequency TX [Hz]": f64
  "Coerced LO frequency RX [Hz]": f64
  "Channel Estimation": cluster{"Element 1": i32[], "Element 2": f64[]}[]
  "TX Block Error Rate": f64
  "Coerced Power Level [dBm]": f64
  "RX Throughput": f64
  "Applied RX Gain [dB]": f64
  "RX Throughput [bits/s]": f64
  "Current TX Block Error Rate (BLER)": f64
  "RX Frequency [Hz]": f64
  "Overwritten by Device MAC Address": bool
  "Station Active": bool
  "Device Ready": bool
  "Baseband RX Power [dBFS]": f64
  "RX Constellation": c128[]
  "RX Power Spectrum": T4
  "TX Power Spectrum": T4
  "Data Transfer": bool
  "FIFO Full": bool
  "FIFO Full": bool
  "Data Transfer": bool
  "Compensated CFO [Hz]": f64
  "TX Data Dropped": bool
  "modulation and coding rate": string
  "MAC RX Statistic": T10
  "Target FIFO Overflow": bool
  "RF Input Power": f64[][]
  "A Data": bool
  "B Data": bool
  "C Data": bool
  "D Data": bool
  "E Data": bool
types:
  T1 = cluster{"TX after SIFS Requests Detected": u32, "TX after SIFS Requests Completed": u32, "TX after Backoff Requests Detected": u32, "TX after Backoff Requests Completed": u32}
  T2 = enum{"Baseband Loopback", "RF Loopback", "RF Multi Station"}
  T3 = enum{"RX1/RF 0", "RX2/RF 0", "RX1/RF 1", "RX2/RF 1"}
  T4 = cluster{"f0": f64, "df": f64, "magnitude": f64[]}
  T5 = cluster{"PhyTxStart": bool, "PhyTxEnd": bool, "PhyRxStart": bool, "PhyRxEnd": bool, "MacChannelState": bool, "MacTxStatus": bool, "PhyCcaTiming": bool, "PhyCcaTiming_2": bool, "PhyCcaTiming_3": bool}
  T6 = cluster{"Timestamp": u32, "Transferred Bytes": u32}
  T7 = cluster{"fpga ref": any, "bus instance": u32, "instruction FIFO depth": u32, "executing on FPGA target": bool, "show error call chain": bool}
  T8 = cluster{"Actual Gain [dB]": f64, "Attenuation Table Index": i32}
  T9 = cluster{"Attenuation Table [dB]": f64[][], "Frequencies [Hz]": f64[], "IQ Imbalance Table": "niUsrpRio Config v1 Host.lvlib__IQ Imbalance.gtype"[], "Gain Table": T8[][]}
  "niInstr Register Bus v0 Host.lvlib__Register Bus Session.gtype" = Queue<"niInstr Register Bus v0 Host.lvlib__Session Data.gtype">
  "Semaphore RefNum.gtype" = i32
  "niUsrpRio Config v1 Host.lvlib__DB Queue Reference.gtype" = Queue<"niUsrpRio Config v1 Host.lvlib__Daughterboard Data.gtype">
  "niUsrpRio Config v1 Host.lvlib__niUsrpRio Session.gtype" = cluster{"FPGA Interface": any, "RIO Interface Number": u32, "Data Clock Rate": u32, "FPGA Data Clock Rate": u32, "Global Settings Register Bus": "niInstr Register Bus v0 Host.lvlib__Register Bus Session.gtype", "Radio 0 Settings Register Bus": "niInstr Register Bus v0 Host.lvlib__Register Bus Session.gtype", "Radio 1 Settings Register Bus": "niInstr Register Bus v0 Host.lvlib__Register Bus Session.gtype", "Radio Settings Bus Semaphore": "Semaphore RefNum.gtype", "DB Queues": "niUsrpRio Config v1 Host.lvlib__DB Queue Reference.gtype"[], "Characterization Data Valid?": bool, "EEPROM Header": "niUsrpRio Config v1 Host.lvlib__EEPROM Header.gtype", "Device Data Header": "niUsrpRio Config v1 Host.lvlib__EEPROM Device Data Header.gtype", "EEPROM Characterization Header": "niUsrpRio Config v1 Host.lvlib__EEPROM Characterization Header.gtype", "Characterization Data": "niUsrpRio Config v1 Host.lvlib__Characterization Data.gtype"[], "FPGA Current Version": u32, "FPGA Oldest Compatible Version": u32, "Fixed Logic Current Version": u32, "Fixed Logic Oldest Compatible Version": u32, "FPGA Radio Settings Bus Current Version": u32, "FPGA Radio Settings Bus Oldest Compatible Version": u32, "FPGA Board Config Current Version": u32, "FPGA Board Config Oldest Compatible Version": u32, "Daughterboard Clock Rate": u32}
  "802.11 Host Session.gtype" = cluster{"FPGA interface": "802.11 FGPA Reference.gtype", "send queue": Queue<u8[]>, "receive queue": Queue<u8[]>, "receive throughput queue": Queue<T6>, "UDP Receiver": UdpNetworkConnectionRefnum, "PN packet": u8[], "FlexRIO session": Queue<T7>, "FlexRIO TX Characterization Data": T9, "FlexRIO RX Characterization Data": T9, "USRP session": "niUsrpRio Config v1 Host.lvlib__niUsrpRio Session.gtype", "RF loop clock frequency": f64, "send queue_2": Queue<u8[]>, "send queue_3": Queue<u8[]>, "send queue_4": Queue<u8[]>, "send queue_5": Queue<u8[]>, "UDP Receiver_2": UdpNetworkConnectionRefnum, "UDP Receiver_3": UdpNetworkConnectionRefnum, "UDP Receiver_4": UdpNetworkConnectionRefnum, "UDP Receiver_5": UdpNetworkConnectionRefnum}
  T10 = cluster{"Packet Starts detected": u32, "Frames from PHY": u32, "Frames with FCS pass": u32, "ACKs Received": u32}
  T11 = enum{"UDP", "PN Data", "Manual", "UDP with 5 sources"}
  "USRP bandwidth.gtype" = enum{"40 MHz", "120 MHz", "160 MHz"}
  T12 = cluster{"TX after SIFS requests detected": u32, "TX after SIFS requests completed": u32, "TX after backoff requests detected": u32, "TX after backoff requests completed": u32}
  T13 = cluster{"Frames detected": u32, "Subframes received": u32, "Valid subframes received": u32, "ACKs received": u32}
  T14 = cluster{"PhyTxStart": bool, "PhyTxEnd": bool, "PhyRxStart": bool, "PhyRxEnd": bool, "MacChannelState": bool, "MacTxStatus": bool, "PhyCcaTiming": bool, "PhyRxGainChange": bool, "PhyRxAGCStateChange": bool}
  T15 = cluster{"remove header": bool, "block unsupported frame types": bool, "block FCS errors": bool, "block address mismatch": bool, "block header recognize error": bool}
diagram:
  sequence {
    frame 0 {
      $Events <- EmptyString
      $"Device Ready" <- FALSE
      $"Station Active" <- FALSE
      $Station <- FALSE
      $"RX Constellation" <- c128[] []
      $"RX Power Spectrum" <- T4 {all zero or empty}
      $"TX Power Spectrum" <- T4 {all zero or empty}
      $"Channel Estimation" <- cluster{"Element 1": i32[], "Element 2": f64[]}[] []
      $"MAC TX Statistic" <- T12 {all zero or empty}
      $"MAC RX Statistic" <- T13 {all zero or empty}
      $"Current TX Block Error Rate (BLER)" <- 0
      $"RX Throughput [bits/s]" <- 0
      $"Compensated CFO [Hz]" <- 0
      for (N = 51) {
        $"RX Throughput" <- NaN
        $"TX Block Error Rate" <- NaN
        $"Baseband Power" <- NaN
      }
      Initialize Array(element=NaN, size=51, size=2) -> w1
      $"RF Input Power" <- w1
    }
  }
  call "Create Stop Notifier.gvi"(error in=no error) -> (error out=w2)
  call "802.11 Host Init.gvi"(device=$"RIO Device", error in=w2, reference clock=$"Reference Clock", USRP bandwidth=$"USRP bandwidth") -> (session out=w3, error out=w4)
  case (w4) {
    frame Error {
      w5 = w4
    }
    frame No Error {
      $"Device Ready" <- TRUE
      $session <- w3
      w5 = w4
    }
  }
  s1 = w5  # shift register
  while {
    # RX Reception
    call "802.11 Unbundle Session.gvi"(session=$session) -> (FPGA interface=w6, receive queue=w7, receive throughput queue=w8)
    call "802.11 Receive RX ICP.gvi"(FPGA interface=w6, error in=s1, receive queue=w7, receive throughput queue=w8, enqueue decoded data=$"Station Active") -> (error out=w9)
    call "Check Stop.gvi"(error in=w9) -> (error out=w10, stop=w11)
    Wait Until Next Multiple(multiple to wait=0)
    next s1 = w10
    stop if w11
  }
  call "Stop On Error.gvi"(error in=s1) -> (error out=w12)
  s2 = w5  # shift register
  s3 = string[] []  # shift register
  while {
    call "802.11 Unbundle Session.gvi"(session=$session) -> (FPGA interface=w13)
    call "802.11 Prepare Constellation.gvi"(FPGA interface=w13, error in=s2, maximal number of subcarriers=4800) -> (error out=w14, data field constellation=w15, update constellation=w16)
    # update plots and indicators (slow)
    Logical And($"Station Active", w16) -> w17
    case (w17) {
      frame False { }
      frame True {
        $"RX Constellation" <- w15
      }
    }
    call "802.11 Read Event FIFO.gvi"(FPGA interface=w13, error in=s2) -> (raw events=w18, error out=w19)
    call "802.11 Prepare RX Power Spectrum.gvi"(FPGA interface=w13, error in=s2) -> (error out=w20, RX power spectrum=w21, update power spectrum=w22)
    call "802.11 Prepare TX Power Spectrum.gvi"(FPGA interface=w13, error in=s2) -> (error out=w23, TX power spectrum=w24, update power spectrum=w25)
    call "802.11 Prepare Channel Estimation.gvi"(FPGA interface=w13, error in=s2, channel subband=$"Primary Subband", subcarrier format=$"Subcarrier Format") -> (error out=w26, channel estimation=w27, update power spectrum=w28)
    call "802.11 Read Target Registers.gvi"(FPGA interface=w13, error in=s2) -> (error out=w29, target FIFO overflow=w30, compensated CFO=w31, RF input power=w32, MAC RX statistics=w33, MAC TX statistics=w34, signal power at packet start=w35)
    Merge Errors(w14, w20, w23, w26, w29, w19) -> (error out=w36)
    call "Check Stop.gvi"(error in=w36) -> (error out=w37, stop=w38)
    Logical And($"Station Active", w22) -> w39
    case (w39) {
      frame False, Default { }
      frame True {
        $"RX Power Spectrum" <- w21
      }
    }
    Logical And($"Station Active", w25) -> w40
    case (w40) {
      frame False, Default { }
      frame True {
        $"TX Power Spectrum" <- w24
      }
    }
    Logical And($"Station Active", w28) -> w41
    case (w41) {
      frame False, Default { }
      frame True {
        $"Channel Estimation" <- w27
      }
    }
    $"Target FIFO Overflow" <- w30
    $"Compensated CFO [Hz]" <- w31
    $"RF Input Power" <- w32
    $"Baseband Power" <- w35
    $"MAC RX Statistic" <- w33
    $"MAC TX Statistic" <- w34
    call "802.11 Events to String.gvi"(event data=w18, events to track=$"Events to Track") -> (event strings=w42)
    for {
      w43 = each element of w42
      Match Pattern(regular expression="PhyRxStart.ind ", string=w43) -> (offset past match=w45)
      Is Not Equal(x=w45, y=-1) -> w46
      append w46 to w44
    }
    Or Array Elements(Boolean array=w44)
    w47 = -12  # CFX data type offset
    Add(w35, w47) -> w48
    $"Baseband RX Power [dBFS]" <- w48
    Build Array[ConcatenateInputs=True](s3, w42) -> w49
    Delete From Array(inArray=w49, length (1)=10000) -> (deleted=w50)
    Select(s=$"Clear events", t=string[] [], f=w50) -> w51
    Concatenate Strings(w50) -> w52
    $Events <- w52
    Select(s=$None, t=T14 {all zero or empty}, f=$"Events to Track") -> w53
    w54 = T14 {"PhyTxStart"=TRUE, "PhyTxEnd"=TRUE, "PhyRxStart"=TRUE, "PhyRxEnd"=TRUE, "MacChannelState"=TRUE, "MacTxStatus"=TRUE, "PhyCcaTiming"=TRUE, "PhyRxGainChange"=TRUE, "PhyRxAGCStateChange"=TRUE}
    Select(s=$All, t=w54, f=w53) -> w55
    $"Events to Track" <- w55
    Wait Until Next Multiple(multiple to wait=250)
    next s2 = w37
    next s3 = w51
    stop if w38
  }
  call "Stop On Error.gvi"(error in=s2) -> (error out=w56)
  s4 = w5  # shift register
  while {
    Feedback Node(input=$"Station Active") -> w57
    Is Not Equal(x=$"Station Active", y=w57) -> w58
    # update plots and indicators (fast)
    case ($"Station Active") {
      frame False, Default {
        w59 = s4
      }
      frame True {
        call "802.11 Unbundle Session.gvi"(session=$session) -> (FPGA interface=w60, receive throughput queue=w61)
        call "802.11 Prepare Throughput Measurements.gvi"(reset=w58, FPGA interface=w60, receive throughput queue=w61, error in=s4, timing granularity=100) -> (error out=w59, TX block error rate=w62, RX throughput=w63)
        $"Current TX Block Error Rate (BLER)" <- w62
        $"TX Block Error Rate" <- w62
        $"RX Throughput [bits/s]" <- w63
        Divide(x=w63, y=1000000) -> w64
        $"RX Throughput" <- w64
      }
    }
    call "Check Stop.gvi"(error in=w59) -> (error out=w65, stop=w66)
    Wait Until Next Multiple(multiple to wait=100)
    next s4 = w65
    stop if w66
  }
  call "Stop On Error.gvi"(error in=s4) -> (error out=w67)
  w68 = $"Data Source"
  Udp Open(error in=w5, net address=0, port=0, service name="", timeout ms=25000) -> (connection ID=w69, error out=w70)
  call "Set Socket Option.gvi"(connection in=w69, level=0xFFFF, option name=0x1001, value=1024000, error in=w70) -> (error out=w71, connection out=w72)
  s5 = w71  # shift register
  s6 = w72  # shift register
  while {
    # UDP send and receive
    Property Node(instance in=$session) -> ("send queue"=w73, "send queue_2"=w74, "send queue_3"=w75, "send queue_4"=w76, "send queue_5"=w77, "UDP Receiver"=w78, "UDP Receiver_2"=w79, "UDP Receiver_3"=w80, "UDP Receiver_4"=w81, "UDP Receiver_5"=w82, "PN packet"=w83, "receive queue"=w84)
    case ($"Station Active") {
      frame False, Default {
        w85 = s5
        w86 = s6
      }
      frame True {
        Array Subset(array=w83, length0=$"PN Data Packet Size") -> w87
        case (w68) {
          frame "UDP" {
            # UDP
            call "802.11 Receive UDP Data.gvi"(UDP receiver=w78, send queue=w73, error in=s5) -> (data transfer=w89, error out=w88, FIFO full=w90)
            $"FIFO Full" <- w90
          }
          frame "PN Data" {
            # PN data
            call "802.11 Send PN Data.gvi"(PN packets per second=$"PN Packets per Second", send queue=w73, PN data=w87, error in=s5) -> (data transfer=w89, error out=w88)
          }
          frame "Manual", Default {
            # Manual
            case ($"Trigger TX") {
              frame False, Default {
                w88 = s5
                w89 = $"Trigger TX"
              }
              frame True {
                Enqueue Element(element=w87, error in=s5, queue=w73, timeout in ms=-1) -> (error out=w88, queue out=w91)
                w89 = $"Trigger TX"
              }
            }
          }
          frame "UDP with 5 sources" {
            call "802.11 Receive UDP Data.gvi"(UDP receiver=w78, send queue=w73, error in=s5) -> (data transfer=w92, error out=w93)
            call "802.11 Receive UDP Data.gvi"(UDP receiver=w79, send queue=w74, error in=s5) -> (data transfer=w94, error out=w95)
            call "802.11 Receive UDP Data.gvi"(UDP receiver=w80, send queue=w75, error in=s5) -> (data transfer=w96, error out=w97)
            call "802.11 Receive UDP Data.gvi"(UDP receiver=w81, send queue=w76, error in=s5) -> (data transfer=w98, error out=w99)
            call "802.11 Receive UDP Data.gvi"(UDP receiver=w82, send queue=w77, error in=s5) -> (data transfer=w100, error out=w101)
            case ($"UDP Port Selection (Choose 0 for all other Data Source Options)") {
              frame 0, Default {
                w88 = w93
                w89 = w92
              }
              frame 1 {
                w88 = w95
                w89 = w94
              }
              frame 2 {
                w88 = w97
                w89 = w96
              }
              frame 3 {
                w88 = w99
                w89 = w98
              }
              frame 4 {
                w88 = w101
                w89 = w100
              }
            }
            $"A Data" <- w92
            $"B Data" <- w94
            $"C Data" <- w96
            $"D Data" <- w98
            $"E Data" <- w100
          }
        }
        $"Data Transfer" <- w89
        Is Equal(x=$"Data Sink", y="UDP") -> w102
        call "802.11 Send UDP Data.gvi"(target port=$"Transmit Port", target IP address=$"Transmit IP Address", receive queue=w84, UDP sender=s6, enable=w102, error in=s5) -> (FIFO full=w103, error out=w104, UDP sender dup=w86, data transfer=w105)
        $"Data Transfer" <- w105
        $"FIFO Full" <- w103
        Merge Errors(w88, w104) -> (error out=w85)
      }
    }
    call "Check Stop.gvi"(error in=w85) -> (error out=w106, stop=w107)
    Wait Until Next Multiple(multiple to wait=0)
    next s5 = w106
    next s6 = w86
    stop if w107
  }
  call "Stop On Error.gvi"(error in=s5) -> (error out=w108)
  Udp Close(connection ID=s6, error in=w108) -> (error out=w109)
  s7 = w5  # shift register
  while {
    Property Node(instance in=$session_2) -> ("send queue"=w110, "send queue_2"=w111, "send queue_3"=w112, "send queue_4"=w113, "send queue_5"=w114, "FPGA interface"=w115)
    # TX transmission
    w116 = $"Station Active"
    w117 = $"UDP Port Selection (Choose 0 for all other Data Source Options)"
    while {
      Dequeue Element(error in=s7, queue=w110, timeout in ms=0) -> (element=w118, error out=w119, timed out?=w120)
      Dequeue Element(error in=s7, queue=w111, timeout in ms=0) -> (element=w121, error out=w122, timed out?=w123)
      Dequeue Element(error in=s7, queue=w112, timeout in ms=0) -> (element=w124, error out=w125, timed out?=w126)
      Dequeue Element(error in=s7, queue=w113, timeout in ms=0) -> (element=w127, error out=w128, timed out?=w129)
      Dequeue Element(error in=s7, queue=w114, timeout in ms=0) -> (element=w130, error out=w131, timed out?=w132)
      case (w117) {
        frame 0, Default {
          w133 = w118
          w134 = w120
          w135 = w119
        }
        frame 1 {
          w133 = w121
          w134 = w123
          w135 = w122
        }
        frame 2 {
          w133 = w124
          w134 = w126
          w135 = w125
        }
        frame 3 {
          w133 = w127
          w134 = w129
          w135 = w128
        }
        frame 4 {
          w133 = w130
          w134 = w132
          w135 = w131
        }
      }
      Logical And(w116, not w134) -> w136
      case (w136) {
        frame False {
          w137 = w135
        }
        frame True {
          call "802.11 Subcarrier Format to Configuration.gvi"(MCS=$MCS, subcarrier format=$"Subcarrier Format", error in=w135) -> (error out=w138, format=w139, bandwidth=w140, valid configuration=w141)
          Is Not Equal(x=$"Operation Mode", y="RF Multi Station") -> w142
          Select(s=w142, t=$"Device MAC Address", f=$"Destination MAC Address") -> w143
          case (w141) {
            frame False, Default {
              w144 = FALSE
              w137 = w138
            }
            frame True {
              call "802.11 Send TX ICP.gvi"(FPGA interface=w115, MCS=$MCS, device MAC address=$"Device MAC Address", error in=w138, destination MAC address=w143, payload=w133, format=w139, bandwidth=w140) -> (dropped?=w144, error out=w137)
            }
          }
          $"TX Data Dropped" <- w144
          $"Overwritten by Device MAC Address" <- w142
        }
      }
      call "Check Stop.gvi"(error in=w137) -> (error out=w145, stop=w146)
      Logical Or(w146, w134) -> w147
      stop if w147
    }
    call "Check Stop.gvi"(error in=w145) -> (error out=w148, stop=w149)
    Wait Until Next Multiple(multiple to wait=0)
    next s7 = w148
    stop if w149
  }
  call "Stop On Error.gvi"(error in=s7) -> (error out=w150)
  s8 = w5  # shift register
  while {
    # configuration
    call "802.11 Unbundle Session.gvi"(session=$session) -> (FPGA interface=w151)
    Feedback Node(input=$"Station Active") -> w152
    case ($"Station Active") {
      frame False, Default {
        w153 = s8
      }
      frame True {
        Is Not Equal(x=$"Station Active", y=w152) -> w154
        call "802.11 Gain Control.gvi"(initialize=w154, RX Port (USRP only)=$"RX Port (USRP only)", session=$session, AGC=$AGC, error in=s8, Manual RX gain [dB]=$"Manual RX gain [dB]", RX Frequency [Hz]=$"RX Frequency [Hz]", TX Port (USRP only)=$"TX Port (USRP only)") -> (Applied RX Gain [dB]=w155, error out=w156)
        $"Applied RX Gain [dB]" <- w155
        call "802.11 Subcarrier Format to Configuration.gvi"(MCS=$MCS, subcarrier format=$"Subcarrier Format", error in=s8) -> (error out=w157, format=w158)
        call "802.11 Configure Dynamic Parameters.gvi"(FPGA interface=w151, error in=w157, format=w158, transmit ACK=$"Transmit ACK", backoff value=$Backoff, CCA energy detection threshold=$"CCA Energy Detection Threshold [dBm]") -> (error out=w159)
        Merge Errors(w156, w159) -> (error out=w153)
      }
    }
    w160 = $Station
    Feedback Node(input=w160) -> w161
    Logical Exclusive Or(w160, w161) -> w162
    case (w162) {
      frame False, Default {
        w163 = s8
      }
      frame True {
        case (w160) {
          frame False, Default {
            sequence {
              frame 0 {
                $"Station Active" <- w160
              }
            }
            call "802.11 Unbundle Session.gvi"(session=$session) -> (UDP receiver=w164)
            Udp Close(connection ID=w164, error in=s8) -> (error out=w165)
            call "Clear Errors.gvi"(specific error code to clear=1, error in=w165) -> (error out=w166)
            call "802.11 Abort RF Streams.gvi"(session=$session, error in=w166) -> (error out=w163)
          }
          frame True {
            $"RX Frequency [Hz]" <- $"TX Frequency [Hz]"
            call "802.11 FPGA Target Configuration.gvi"() -> (maximum gain=w167, enable DC offset correction=w168)
            w169 = T15 {"remove header"=TRUE, "block unsupported frame types"=TRUE, "block FCS errors"=TRUE, "block address mismatch"=TRUE, "block header recognize error"=TRUE}
            call "802.11 Configure Static Parameters.gvi"(session in=$session, error in=s8, primary subband=$"Primary Subband", operation mode=$"Operation Mode", enable DC offset correction=w168, MPDU filter configuration=w169, device MAC address=$"Device MAC Address") -> (session dup=w170, error out=w171)
            call "802.11 Reset Statistics.gvi"(session in=w170, error in=w171, reset RX statistics=TRUE, reset TX statistics=TRUE) -> (error out=w172, session dup=w173)
            call "802.11 Configure TX RF.gvi"(TX port=$"TX Port (USRP only)", session=w173, TX frequency=$"TX Frequency [Hz]", TX power level=$"Power Level [dBm]", error in=w172) -> (session dup=w174, error out=w175, coerced TX power level=w176, coerced LO frequency=w177)
            call "802.11 Configure RX RF.gvi"(RX frequency=$"TX Frequency [Hz]", session=w174, RX gain=w167, error in=w175, RX port=$"RX Port (USRP only)") -> (error out=w178, session dup=w179, coerced RX gain=w180, coerced LO frequency=w181)
            call "802.11 Configure AGC Registers.gvi"(TX Port=$"TX Port (USRP only)", enable AGC=FALSE, session=w179, RX port=$"RX Port (USRP only)", error in=w178) -> (error out=w182, session dup=w183)
            call "802.11 Set Power Calibration Offset.gvi"(session=w183, frequency=$"TX Frequency [Hz]", error in=w182, RX port=$"RX Port (USRP only)") -> (session dup=w184, error out=w185)
            call "802.11 Configure RF Streams.gvi"(TX port=$"TX Port (USRP only)", RX port=$"RX Port (USRP only)", session=w184, error in=w185) -> (session dup=w186, error out=w187)
            case (w68) {
              frame "UDP" {
                call "802.11 Configure Data Source.gvi"(error in=w187, receive port=$"Receive Port", session in=w186) -> (error out=w163, session out=w188, success?=w189)
              }
              frame "PN Data" {
                call "802.11 Configure Data Source.gvi"(error in=w187, receive port=$"Receive Port", session in=w186) -> (error out=w163, session out=w188, success?=w189)
              }
              frame "Manual", Default {
                call "802.11 Configure Data Source.gvi"(error in=w187, receive port=$"Receive Port", session in=w186) -> (error out=w163, session out=w188, success?=w189)
              }
              frame "UDP with 5 sources" {
                call "CONFIGURE DATA SOURCE VICTOR.gvi"(receive port=$"UDP A Port", session in=w186, error in=w187, receive port_2=$"UDP B Port", receive port_3=$"UDP C Port", receive port_4=$"UDP D Port", receive port_5=$"UDP E Port") -> (session out=w188, success?=w189, error out=w163)
              }
            }
            $session <- w188
            sequence {
              frame 0 {
                $Station <- w189
                $"Station Active" <- w160
              }
            }
            $"Coerced LO frequency RX [Hz]" <- w181
            $"Applied RX Gain [dB]" <- w180
            $"Coerced LO frequency TX [Hz]" <- w177
            $"Coerced Power Level [dBm]" <- w176
          }
        }
      }
    }
    call "802.11 Reset Statistics.gvi"(session in=$session, error in=s8, reset RX statistics=$"reset RX staistics", reset TX statistics=$"reset TX staistics") -> (error out=w190)
    call "802.11 Subcarrier Format to Configuration.gvi"(MCS=$MCS, subcarrier format=$"Subcarrier Format", error in=w190) -> (modulation and coding rate=w191, error out=w192)
    Merge Errors(w153, w163, w192) -> (error out=w193)
    call "Create Stop.gvi"(error in=w193, stop in=$Stop) -> (error out=w194)
    call "Check Stop.gvi"(error in=w194) -> (error out=w195, stop=w196)
    Wait Until Next Multiple(multiple to wait=100)
    $"modulation and coding rate" <- w191
    next s8 = w195
    stop if w196
  }
  call "Stop On Error.gvi"(error in=s8) -> (error out=w197)
  Merge Errors(w197, w150, w12, w109, w56, w67) -> (error out=w198)
  sequence {
    frame 0 {
      w199 = $session
    }
  }
  call "802.11 Host Release.gvi"(session=w199, error in=w198) -> (error out=w200)
  call "Simple Error Handler.gvi"(type of dialog="OK message", error in=w200)
